# Grasshopper definition IMSar.gh (Grasshopper 1.0.7)
# plug-ins: MeshStreaming, MarchingCubes, MeshEdit Components, jSwan

path = FilePath("F:\IMS_Server\GH\sample_files\sample_cube.json")
dejson = DeserializeJson(JSON=path, OutputsLocked=False)  # -> Project_id, Viewpoint_plane, Collider, Spacing, Grid_points, Color
rejsonkv = SerializeKeysAndValues()
path_2 = FilePath("F:\Seafile\IMSonMars\00 Software\IMSonMars_beta1\points.txt")
dejson_2 = DeserializeJson(JSON=dejson.Grid_points, OutputsLocked=False)  # -> X, Y, Z

file = ReadFile(File=path_2, PerLineParse=True)
fsim = FindSimilarMember(Data="#", Set=file)  # -> Hit, Index
split = SplitList(List=file, Index=fsim.Index)  # -> ListA, ListB
cull_i = CullIndex(List=split.ListB, Indices=0, Wrap=True)

pt = ConstructPoint(XCoordinate=dejson_2.X, YCoordinate=dejson_2.Y, ZCoordinate=dejson_2.Z)
panel = Panel(file)
verbliebene_punkte = Point(pt)
gelöschte_punkte = Point(split.ListA)
split_2 = SplitList(List=verbliebene_punkte, Index=Slider(250, range=0..1000))  # -> ListA, ListB
panel_2 = Panel("grid_points")
relay = Relay()
relay_2 = Relay()

# ----
# Amorph Core
number_slider = Slider(0.3, range=0..1)
point_charge = PointCharge(Point=relay, Radius=number_slider, ChargeStrength=Slider(0.125, range=0..1))
cocoon = Cocoon(
    Charges=point_charge,
    Iso=Slider(0.25, range=0..1),
    CellSize=Slider(0.125, range=0..1),
    Execute=Toggle(True),
    Simple=False)  # -> Mesh, RefinementData

# ----
# Hull
number_slider_2 = Slider(1, range=0..100)
point_charge_2 = PointCharge(Point=split_2.ListA, Radius=Slider(25, range=0..100), ChargeStrength=number_slider_2)
cocoon_2 = Cocoon(
    Charges=point_charge_2,
    Iso=Slider(0.1, range=0..1),
    CellSize=Slider(15, range=0..100),
    Execute=Toggle(True),
    Simple=False)  # -> Mesh, RefinementData

# ----
# Amorph Hull
number_slider_3 = Slider(1, range=0..100)
point_charge_3 = PointCharge(Point=verbliebene_punkte, Radius=Slider(25, range=0..100), ChargeStrength=number_slider_3)
cocoon_3 = Cocoon(
    Charges=point_charge_3,
    Iso=Slider(0.1, range=0..1),
    CellSize=Slider(15, range=0..100),
    Execute=Toggle(True),
    Simple=False)  # -> Mesh, RefinementData

point_charge_4 = PointCharge(Point=relay_2, Radius=Slider(0.275, range=0..1), ChargeStrength=Slider(0.125, range=0..1))
cocoon_4 = Cocoon(
    Charges=point_charge_4,
    Iso=Slider(0.25, range=0..1),
    CellSize=Slider(0.125, range=0..1),
    Execute=Toggle(True),
    Simple=False)  # -> Mesh, RefinementData

refine = Refine(
    RefinementData=cocoon_2.RefinementData,
    Samples=Slider(2, range=0..10),
    SampleSize=Slider(0, range=0..10),
    SampleTolerance=Slider(0, range=0..10),
    LaplacianSmoothing=Slider(0, range=0..10),
    ValencePasses=Slider(2, range=0..10),
    SubD=Slider(1, range=0..10),
    Execute=Toggle(True))

refine_2 = Refine(
    RefinementData=cocoon.RefinementData,
    Samples=Slider(2, range=0..10),
    SampleSize=Slider(2, range=0..10),
    SampleTolerance=Slider(2, range=0..10),
    LaplacianSmoothing=Slider(2, range=0..10),
    ValencePasses=Slider(2, range=0..10),
    SubD=Slider(0, range=0..10),
    Execute=Toggle(True))

refine_3 = Refine(
    RefinementData=cocoon_4.RefinementData,
    Samples=Slider(2, range=0..10),
    SampleSize=Slider(2, range=0..10),
    SampleTolerance=Slider(2, range=0..10),
    LaplacianSmoothing=Slider(2, range=0..10),
    ValencePasses=Slider(2, range=0..10),
    SubD=Slider(0, range=0..10),
    Execute=Toggle(True))

relay_3 = Relay()
relay_4 = Relay()
relay_5 = Relay()

refine_4 = Refine(
    RefinementData=relay_5,
    Samples=Slider(2, range=0..10),
    SampleSize=Slider(2, range=0..10),
    SampleTolerance=Slider(2, range=0..10),
    LaplacianSmoothing=Slider(2, range=0..10),
    ValencePasses=Slider(2, range=0..10),
    SubD=Slider(0, range=0..10),
    Execute=Toggle(True))

material = CreateMaterial(Diffuse=RGB(255, 105, 180), Specular=RGB(255, 255, 255), Emission=RGB(0, 0, 0), Transparency=0, Shine=0)
face_normals = FaceNormals(Mesh=relay_4)  # -> Centers, Normals
value_list = ValueList({"Hülle": 0, "Breps aus Mesh": 3, "Tubes generieren": 1}, selected="Hülle")
cull_nth = CullNth(List=face_normals.Normals, CullFrequency=2)
cull_pattern = CullPattern(List=face_normals.Normals, CullPattern=[False, False, False, False, True, False, False])

# ----
# Verglasung generieren,
# durch Ausschneiden der inneren Hülle
# von der Äußeren
mesh_difference = MeshDifference(MeshesA=refine_2, MeshesB=refine_3)

mesh_eval = MeshEval(Mesh=relay_4, Parameter=cull_pattern)  # -> Point, Normal, Colour
panel_3 = Panel(cull_pattern)
mjoin = MeshJoin(Meshes=mesh_difference)
random = Random(Range=Domain(0, 1), Number=1, Seed=2)
random_2 = Random(Range=Domain(0, 1), Number=1, Seed=2)
random_3 = Random(Range=Domain(0, 1), Number=1, Seed=2)
construct_point = ConstructPoint(XCoordinate=random_3, YCoordinate=random, ZCoordinate=random_2)
stream_gate = StreamGate(Stream=refine_4, Gate=value_list)  # -> Target0, Target1, Target2, Target3

# ----
# Core High-Res
# Hülle generieren, durch Ausschneiden der inneren Hülle von der Äußeren
mint = MeshIntersection(MeshesA=stream_gate.Target0, MeshesB=refine)
mjoin_2 = MeshJoin(Meshes=mint)

plane_normal = PlaneNormal(Origin=construct_point, ZAxis=Vector(0, 0, 1))

mesh = Mesh(refine_4)
mesh_cullunused_vertices = MeshCullUnusedVertices(Mesh=mesh)
plane = Plane(Plane(origin=(-19.02778615, 1.291932132, 0), x=(0.2057696271, 0.9774400397, 0.04764272602), y=(0.7919463914, -0.1949240319, 0.5786411107)))
rotate_3d = Rotate3D(Geometry=plane, Angle=Slider(115, range=0..360), Center=plane, Axis=Vector(0, 0, 1))  # -> Geometry, Transform
rotate_3d_2 = Rotate3D(Geometry=plane, Angle=Slider(60, range=0..360), Center=plane, Axis=Vector(0, 0, 1))  # -> Geometry, Transform
rotate_3d_3 = Rotate3D(Geometry=plane, Angle=Slider(150, range=0..360), Center=plane, Axis=Vector(0, 0, 1))  # -> Geometry, Transform
mesh_plane = MeshPlane(Mesh=mesh_cullunused_vertices, Geometry=[rotate_3d.Geometry, plane, plane_normal, rotate_3d_2.Geometry])
curve_charge = CurveCharge(Curve=flatten(mesh_plane), Radius=Slider(0.5, range=-1..1), ChargeStrengths=Slider(7, range=-10..100))
cocoon_5 = Cocoon(
    Charges=[curve_charge, relay_3],
    Iso=Slider(8, range=1..10),
    CellSize=Slider(0.07, range=-1..1),
    Execute=Toggle(True),
    Simple=False)  # -> Mesh, RefinementData

# ----
# Breps aus Mesh generieren
deconstruct_mesh = DeconstructMesh(Mesh=stream_gate.Target3)  # -> Vertices, Faces, Colours, Normals
deconstruct_face = DeconstructFace(Face=deconstruct_mesh.Faces)  # -> CornerA, CornerB, CornerC, CornerD
list_item = ListItem(List=deconstruct_mesh.Vertices, Index=deconstruct_face.CornerA, Wrap=True)
list_item_2 = ListItem(List=deconstruct_mesh.Vertices, Index=deconstruct_face.CornerB, Wrap=True)
list_item_3 = ListItem(List=deconstruct_mesh.Vertices, Index=deconstruct_face.CornerC, Wrap=True)
list_item_4 = ListItem(List=deconstruct_mesh.Vertices, Index=deconstruct_face.CornerD, Wrap=True)
_4point_surface = _4PointSurface(CornerA=list_item, CornerB=list_item_2, CornerC=list_item_3, CornerD=list_item_4)
brep_join = BrepJoin(Breps=_4point_surface)  # -> Breps, Closed

weave = Weave(Pattern=[0, 1, 2, 3], Stream0=mjoin_2, Stream1=mjoin, NullGaps=False)
value_list_2 = ValueList({"Hülle": 0, "Breps aus Mesh": 3, "Verglasung": 1}, selected=[])
preview = CustomPreview(Geometry=mesh_cullunused_vertices, Material=ColourSwatch(SwatchColor=RGB(53, 54, 41)))
preview_2 = CustomPreview(Geometry=refine_2, Material=ColourSwatch(SwatchColor=RGBA(252, 255, 255, 120)))
stream_gate_2 = StreamGate(Stream=weave, Gate=value_list_2)  # -> Target0, Target1, Target2, Target3
preview_3 = CustomPreview(
    Geometry=curve_charge,
    Material={diffuse=RGB(221, 160, 221), emission=RGB(66, 48, 66), shine=0.5, specular=RGB(255, 255, 255), transparency=0})

# ----
# Breps aus Mesh generieren
deconstruct_mesh_2 = DeconstructMesh(Mesh=stream_gate_2.Target3)  # -> Vertices, Faces, Colours, Normals
deconstruct_face_2 = DeconstructFace(Face=deconstruct_mesh_2.Faces)  # -> CornerA, CornerB, CornerC, CornerD
list_item_5 = ListItem(List=deconstruct_mesh_2.Vertices, Index=deconstruct_face_2.CornerA, Wrap=True)
list_item_6 = ListItem(List=deconstruct_mesh_2.Vertices, Index=deconstruct_face_2.CornerB, Wrap=True)
list_item_7 = ListItem(List=deconstruct_mesh_2.Vertices, Index=deconstruct_face_2.CornerC, Wrap=True)
list_item_8 = ListItem(List=deconstruct_mesh_2.Vertices, Index=deconstruct_face_2.CornerD, Wrap=True)
_4point_surface_2 = _4PointSurface(CornerA=list_item_5, CornerB=list_item_6, CornerC=list_item_7, CornerD=list_item_8)
brep_join_2 = BrepJoin(Breps=_4point_surface_2)  # -> Breps, Closed

material_2 = CreateMaterial(
    Diffuse=ColourSwatch(SwatchColor=RGB(255, 99, 99)),
    Specular=ColourSwatch(SwatchColor=RGB(255, 25, 25)),
    Emission=ColourSwatch(SwatchColor=RGB(0, 0, 0)),
    Transparency=Slider(0.8, range=0..1),
    Shine=Slider(54, range=0..100))
preview_4 = CustomPreview(Geometry=cocoon_5.Mesh, Material=material_2)

# ----
# Schnittebenen und Kurven generieren
bounding_box = BoundingBox(Content=stream_gate.Target1, Plane=PlaneXY(0, 0, 0))  # -> Box, Box_2
deconstruct_box = DeconstructBox(Box=bounding_box.Box)  # -> Plane, X, Y, Z
divide_domain = DivideDomain(Domain=deconstruct_box.Z, Count=Slider(20, range=0..30))
deconstruct_domain = DeconstructDomain(Domain=divide_domain)  # -> Start, End
construct_point_2 = ConstructPoint(XCoordinate=0, YCoordinate=0, ZCoordinate=deconstruct_domain.Start)
plane_normal_2 = PlaneNormal(Origin=construct_point_2, ZAxis=Vector(0, 0, 1))
mesh_plane_2 = MeshPlane(Mesh=stream_gate.Target1, Plane=plane_normal_2)

connectsocket = ConnectSocket(Address=<missing>, Connect=<missing>)  # -> Status, Socket
meshserialize = MeshSerialize(Mesh=<missing>)
sendmesh = SendMesh(Bytes=meshserialize, Socket=connectsocket.Socket, TargetEvent="gh", Send=<missing>)  # -> Status, Length

simplify_curve = SimplifyCurve(Curve=mesh_plane_2, Tolerance=Slider(22, range=0..100), AngleTolerance=Slider(0, range=0..360))  # -> Curve, flatten(Simplified)
length = Length(Curve=simplify_curve.Curve)
smaller_than = SmallerThan(FirstNumber=length, SecondNumber="1")  # -> SmallerThan, OrEqualTo
larger_than = LargerThan(FirstNumber=length, SecondNumber="1")  # -> LargerThan, OrEqualTo
cull_pattern_2 = CullPattern(List=simplify_curve.Curve, CullPattern=larger_than.LargerThan)

unit_x = UnitX(Factor=1)
unit_y = UnitY(Factor=1)
curve = Curve([<curve referenced from the Rhino model> x15])
project = Project(Curve=curve, Brep=brep_join.Breps, Direction=unit_y)
join_curves = JoinCurves(Curves=project, Preserve=False)
clean_tree = CleanTree(RemoveNulls=True, RemoveInvalid=True, RemoveEmpty=Toggle(True), Tree=join_curves)
rebuild_curve = RebuildCurve(Curve=mesh_plane_2, Degree=2, Count=30, Tangents=False)
curve_group_charge = CurveGroupCharge(Radius=Slider(0.1, range=0..10), ChargeStrengths=Slider(0.15, range=0..1))
cocoon_6 = Cocoon(
    Charges=curve_group_charge,
    Iso=Slider(1, range=0..1),
    CellSize=Slider(0.05, range=0..1),
    Execute=Toggle(True),
    Simple=False)  # -> Mesh, RefinementData
pipe = Pipe(Curve=cull_pattern_2, Radius=Slider(0.1, range=0..10), Caps=2)

refine_5 = Refine(
    RefinementData=cocoon_6.RefinementData,
    Samples=Slider(2, range=0..10),
    SampleSize=Slider(2, range=0..10),
    SampleTolerance=Slider(2, range=0..10),
    LaplacianSmoothing=Slider(2, range=0..10),
    ValencePasses=Slider(2, range=0..10),
    SubD=Slider(0, range=0..10),
    Execute=Toggle(False))

mesh_join = MeshJoin(Meshes=refine_5)
