# Grasshopper definition value_list_new.gh (Grasshopper 1.0.7)

list = ValueList({"One": 1, "Two": 2, "Three": 2² - 1, "Four": Sqrt(16)}, selected="Two")
list_2 = ValueList({"One": 1, "Two": 2, "Three": 2² - 1, "Four": Sqrt(16)}, selected="One")

# ---- group: RH_IN:Test
int = Integer(list)

# ---- group: RH_IN:number
int_2 = Integer(list_2)

# ----
series = Series(Start=0, Step=int, Count=int_2)
multiplication = Multiplication(A=series, B=Slider(25, range=0..100))
msphere = MeshSphere(Base=PlaneXY(0, 0, 0), Radius=10, UCount=10, VCount=20)
X = UnitX(Factor=multiplication)
move = Move(Geometry=msphere, Motion=X)  # -> Geometry, Transform

# ---- group: RH_OUT:spheres
mesh = Mesh(move.Geometry)
